# Grasshopper definition radiation analysis.gh (Grasshopper 1.0.7)

epwmap = LBEPWmap(epw_map=Toggle(False))  # -> report; plug-in component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
panel = Panel("https://energyplus-weather.s3.amazonaws.com/europe_wmo_region_6/AUT/AUT_Innsbruck.111200_IWEC/AUT_Innsbruck.111200_IWEC.zip")
epwmap_2 = LBEPWmap()  # -> report; plug-in component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
downloadepw = LBDownloadWeather()  # -> epw_file, stat_file, ddy_file; plug-in component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
downloadepw_2 = LBDownloadWeather(weather_URL=panel)  # -> epw_file, stat_file, ddy_file; plug-in component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
importepw = LBImportEPW(epw_file=downloadepw_2.epw_file)  # -> location, dry_bulb_temperature, dew_point_temperature, relative_humidity, wind_speed, wind_direction, direct_normal_rad, diffuse_horizontal_rad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; plug-in component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
mesh = Mesh([<mesh referenced from the Rhino model> x1068])
mesh_2 = Mesh([<mesh referenced from the Rhino model> x61])
analysisperiod = LBAnalysisPeriod(start_month=1, start_day=1, start_hour=Slider(10, range=0..10), end_hour=Slider(19, range=0..100))  # -> period, hoys, dates; plug-in component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
brep = Brep([<brep referenced from the Rhino model> x16])
vec = Vector(Vector(-5.447999959, 149.3129999, 6.557006836))
faceb = FaceBoundaries(Mesh=mesh)
boundary = BoundarySurfaces(Edges=faceb)
skymatrix = LBCumulativeSkyMatrix(
    north=vec,
    location=importepw.location,
    direct_rad=importepw.direct_normal_rad,
    diffuse_rad=importepw.diffuse_horizontal_rad,
    hoys=analysisperiod.hoys)  # -> report, sky_mtx; plug-in component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
join = BrepJoin(Breps=boundary)  # -> Breps, Closed
brep_2 = Brep(join.Breps)
benefitmatrix = LBBenefitSkyMatrix()  # -> report, sky_mtx; plug-in component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
brep_3 = Brep(join.Breps)
incidentradiation = LBIncidentRadiation(
    sky_mtx=skymatrix.sky_mtx,
    geometry=flatten(brep),
    context=flatten(mesh_2),
    grid_size=Slider(1, range=0..10000),
    offset_dist=Slider(1, range=0..10),
    run=Toggle(True))  # -> report, points, results, total, mesh, legend, title, int_mtx; plug-in component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
mesh_3 = Mesh(incidentradiation.mesh)
brep_4 = Brep(<brep referenced from the Rhino model>)
brep_5 = Brep(<brep referenced from the Rhino model>)
brep_6 = Brep(<brep referenced from the Rhino model>)
brep_7 = Brep(<brep referenced from the Rhino model>)
brep_8 = Brep(<brep referenced from the Rhino model>)
divide = DivideDomain²(UCount=10, VCount=10)
divide_2 = DivideDomain²(UCount=10, VCount=10)
divide_3 = DivideDomain²(Domain=brep_4, UCount=Slider(10, range=0..100), VCount=Slider(3, range=0..100))
divide_4 = DivideDomain²(Domain=brep_5, UCount=Slider(5, range=0..100), VCount=Slider(12, range=0..100))
divide_5 = DivideDomain²(UCount=10, VCount=10)
incidentradiation_2 = LBIncidentRadiation(
    sky_mtx=skymatrix.sky_mtx,
    geometry=flatten(mesh),
    context=flatten(mesh_2),
    grid_size=Slider(2, range=0..10000),
    offset_dist=Slider(1, range=0..10),
    run=Toggle(True))  # -> report, points, results, total, mesh, legend, title, int_mtx; plug-in component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
divide_6 = DivideDomain²(UCount=10, VCount=10)
divide_7 = DivideDomain²(Domain=brep_6, UCount=Slider(1, range=0..100), VCount=Slider(20, range=0..100))
geo = Geometry(<brep referenced from the Rhino model>)
divide_8 = DivideDomain²(Domain=brep_7, UCount=Slider(1, range=0..100), VCount=Slider(20, range=0..100))
geo_2 = Geometry(<brep referenced from the Rhino model>)
divide_9 = DivideDomain²(UCount=10, VCount=10)
divide_10 = DivideDomain²(Domain=brep_8, UCount=Slider(1, range=0..100), VCount=Slider(20, range=0..100))
subsrf = Isotrim(Surface=brep_4, Domain=divide_3)
subsrf_2 = Isotrim(Surface=brep_5, Domain=divide_4)
volume = Volume(Geometry=geo)  # -> Volume, Centroid
volume_2 = Volume(Geometry=geo_2)  # -> Volume, Centroid
geo_3 = Geometry(<brep referenced from the Rhino model>)
geo_4 = Geometry(<brep referenced from the Rhino model>)
geo_5 = Geometry(<brep referenced from the Rhino model>)
subsrf_3 = Isotrim(Surface=brep_6, Domain=divide_7)
xy = XYPlane(Origin=volume.Centroid)
debrep = DeconstructBrep(Brep=subsrf)  # -> Faces, Edges, Vertices
xy_2 = XYPlane(Origin=volume_2.Centroid)
subsrf_4 = Isotrim(Surface=brep_7, Domain=divide_8)
volume_3 = Volume(Geometry=geo_3)  # -> Volume, Centroid
debrep_2 = DeconstructBrep(Brep=subsrf_2)  # -> Faces, Edges, Vertices
volume_4 = Volume(Geometry=geo_4)  # -> Volume, Centroid
mesh_4 = Mesh(incidentradiation_2.mesh)
subsrf_5 = Isotrim(Surface=brep_8, Domain=divide_10)
volume_5 = Volume(Geometry=geo_5)  # -> Volume, Centroid
xz = XZPlane(Origin=volume.Centroid)
amoments = AreaMoments(Geometry=debrep.Faces)  # -> Area, Centroid, Inertia, InertiaError, Secondary, SecondaryError, Gyration
xz_2 = XZPlane(Origin=volume_2.Centroid)
xy_3 = XYPlane(Origin=volume_3.Centroid)
amoments_2 = AreaMoments(Geometry=debrep_2.Faces)  # -> Area, Centroid, Inertia, InertiaError, Secondary, SecondaryError, Gyration
yz = YZPlane(Origin=volume.Centroid)
debrep_3 = DeconstructBrep(Brep=subsrf_3)  # -> Faces, Edges, Vertices
xy_4 = XYPlane(Origin=volume_4.Centroid)
yz_2 = YZPlane(Origin=volume_2.Centroid)
debrep_4 = DeconstructBrep(Brep=subsrf_4)  # -> Faces, Edges, Vertices
rad = Radians(Degrees=Slider(0, range=0..100))
rad_2 = Radians(Degrees=Slider(0, range=0..100))
xy_5 = XYPlane(Origin=volume_5.Centroid)
debrep_5 = DeconstructBrep(Brep=subsrf_5)  # -> Faces, Edges, Vertices
xz_3 = XZPlane(Origin=volume_3.Centroid)
amoments_3 = AreaMoments(Geometry=debrep_3.Faces)  # -> Area, Centroid, Inertia, InertiaError, Secondary, SecondaryError, Gyration
xz_4 = XZPlane(Origin=volume_4.Centroid)
amoments_4 = AreaMoments(Geometry=debrep_4.Faces)  # -> Area, Centroid, Inertia, InertiaError, Secondary, SecondaryError, Gyration
yz_3 = YZPlane(Origin=volume_3.Centroid)
yz_4 = YZPlane(Origin=volume_4.Centroid)
rad_3 = Radians(Degrees=Slider(0, range=0..100))
rad_4 = Radians(Degrees=Slider(0, range=0..100))
srf_cp = SurfaceClosestPoint(Point=amoments.Centroid, Surface=brep_4)  # -> Point, UVPoint, Distance
srf_cp_2 = SurfaceClosestPoint(Point=amoments_2.Centroid, Surface=brep_5)  # -> Point, UVPoint, Distance
xz_5 = XZPlane(Origin=volume_5.Centroid)
amoments_5 = AreaMoments(Geometry=debrep_5.Faces)  # -> Area, Centroid, Inertia, InertiaError, Secondary, SecondaryError, Gyration
yz_5 = YZPlane(Origin=volume_5.Centroid)
rad_5 = Radians(Degrees=Slider(0, range=0..100))
rotate = Rotate(Geometry=geo, Angle=rad, Plane=xz)  # -> Geometry, Transform
evalsrf = EvaluateSurface(Surface=brep_4, Point=srf_cp.UVPoint)  # -> Point, Normal, UDirection, VDirection, Frame
srf_cp_3 = SurfaceClosestPoint(Point=amoments_3.Centroid, Surface=brep_6)  # -> Point, UVPoint, Distance
evalsrf_2 = EvaluateSurface(Surface=brep_5, Point=srf_cp_2.UVPoint)  # -> Point, Normal, UDirection, VDirection, Frame
srf_cp_4 = SurfaceClosestPoint(Point=amoments_4.Centroid, Surface=brep_7)  # -> Point, UVPoint, Distance
rotate_2 = Rotate(Geometry=geo_2, Angle=rad_2, Plane=yz_2)  # -> Geometry, Transform
srf_cp_5 = SurfaceClosestPoint(Point=amoments_5.Centroid, Surface=brep_8)  # -> Point, UVPoint, Distance
rotate_3 = Rotate(Geometry=geo_3, Angle=rad_3, Plane=xz_3)  # -> Geometry, Transform
rotate_4 = Rotate(Geometry=geo_4, Angle=rad_4, Plane=xz_4)  # -> Geometry, Transform
evalsrf_3 = EvaluateSurface(Surface=brep_6, Point=srf_cp_3.UVPoint)  # -> Point, Normal, UDirection, VDirection, Frame
evalsrf_4 = EvaluateSurface(Surface=brep_7, Point=srf_cp_4.UVPoint)  # -> Point, Normal, UDirection, VDirection, Frame
rotate_5 = Rotate(Geometry=geo_5, Angle=rad_5, Plane=xz_5)  # -> Geometry, Transform
evalsrf_5 = EvaluateSurface(Surface=brep_8, Point=srf_cp_5.UVPoint)  # -> Point, Normal, UDirection, VDirection, Frame
orient = Orient(Geometry=rotate.Geometry, Source=yz, Target=evalsrf.Frame)  # -> Geometry, Transform
orient_2 = Orient(Geometry=rotate_3.Geometry, Source=yz_3, Target=evalsrf_3.Frame)  # -> Geometry, Transform
orient_3 = Orient(Geometry=geo_2, Source=yz_2, Target=evalsrf_2.Frame)  # -> Geometry, Transform
orient_4 = Orient(Geometry=rotate_4.Geometry, Source=yz_4, Target=evalsrf_4.Frame)  # -> Geometry, Transform
orient_5 = Orient(Geometry=rotate_5.Geometry, Source=yz_5, Target=evalsrf_5.Frame)  # -> Geometry, Transform
